# Grasshopper definition Export Without Baking.gh (Grasshopper 1.0.7)

polygon = Polygon(Plane=PlaneXY(0, 0, 0), Radius=3, Segments=5, FilletRadius=0)  # -> Polygon, Length
cir = Circle(Plane=PlaneXY(0, 0, 0), Radius=4)
rectangle = Rectangle(Plane=PlaneXY(0, 0, 0), XSize=Domain(-2, 2), YSize=Domain(-2, 2), Radius=0.25)  # -> Rectangle, Length
join = BrepJoin(Breps=cir)  # -> Breps, Closed
join_2 = BrepJoin(Breps=rectangle.Rectangle)  # -> Breps, Closed
join_3 = BrepJoin(Breps=polygon.Polygon)  # -> Breps, Closed
box = Box({Plane=PlaneXY(0, 0, 0), X=Domain(0, 18), Y=Domain(0, 18), Z=Domain(0, 18)})
arrbox = BoxArray(Geometry=join.Breps, Cell=box, XCount=4, YCount=4, ZCount=1)  # -> Geometry, Transform
arrbox_2 = BoxArray(Geometry=join_2.Breps, Cell=box, XCount=4, YCount=4, ZCount=1)  # -> Geometry, Transform
arrbox_3 = BoxArray(Geometry=join_3.Breps, Cell=box, XCount=4, YCount=4, ZCount=1)  # -> Geometry, Transform
move = Move(Geometry=arrbox_2.Geometry, Motion=Vector(6, -6, 0))  # -> Geometry, Transform
move_2 = Move(Geometry=arrbox_3.Geometry, Motion=Vector(-6, 6, 0))  # -> Geometry, Transform
layer_1_name = Panel("Layer 1")
layer_2_name = Panel("Layer 2")
layer_3_name = Panel("Layer 3")
flatten = FlattenTree(Tree=layer_1_name, Path="0")
flatten_2 = FlattenTree(Tree=layer_2_name, Path="1")
flatten_3 = FlattenTree(Tree=layer_3_name, Path="2")
rhinocommands = Panel("""_Explode
_Convert Output=Arcs SimplifyInput=Yes DeleteInput=Yes AngleTolerance=5 Tolerance=0.001 MinLength=0 MaxLength=0 OutputLayer=Input Enter
_SimplifyCrv""")
layer_1 = ColourSwatch(SwatchColor=RGB(208, 255, 98))
layer_2 = ColourSwatch(SwatchColor=RGB(61, 255, 231))
layer_3 = ColourSwatch(SwatchColor=RGB(180, 57, 255))
layers = Relay([flatten, flatten_2, flatten_3])
preview = CustomPreview(Geometry=arrbox.Geometry, Material=layer_1)
preview_2 = CustomPreview(Geometry=move.Geometry, Material=layer_2)
preview_3 = CustomPreview(Geometry=move_2.Geometry, Material=layer_3)
flatten_4 = FlattenTree(Tree=layer_1, Path="0")
flatten_5 = FlattenTree(Tree=layer_2, Path="1")
flatten_6 = FlattenTree(Tree=layer_3, Path="2")
exportoptions = Panel("Version=5 SaveSmall=No GeometryOnly=No SaveTextures=No SaveNotes=No SavePlugInData=No")
colors = Relay([flatten_4, flatten_5, flatten_6])
flatten_7 = FlattenTree(Tree=arrbox.Geometry, Path="0")
flatten_8 = FlattenTree(Tree=move.Geometry, Path="1")
flatten_9 = FlattenTree(Tree=move_2.Geometry, Path="2")
geometries = Relay([flatten_7, flatten_8, flatten_9])
directory = Panel("C:\Test")
fileprepend = Panel("Export - ")
filename = Panel("Sample")
fileappend = Panel(" - Processed")
extension = ValueList({"3DM": ".3DM", "DXF": ".DXF", "IGES"}, selected="3DM")
export_file_slide_to_right_end_to_export = Slider(2.55, range=2.55..3.45)
press_to_export_hold_until_finished = Button()
toggle_to_true_to_export = BooleanToggle(False)
# Turn Clockwise to activate Export
# |
# V
export = ControlKnob(Decimals=2, Limit=True, Maximum=3.45, Minimum=2.55, Range=1, Value=2.55)
c_script = CSharpScript(
    Geometries=geometries,
    LayerNames=layers,
    LayerColors=colors,
    Directory=directory,
    FilePrepend=fileprepend,
    Filename=filename,
    FileAppend=fileappend,
    Extension=extension,
    ExportOptions=exportoptions,
    RhinoCommands=rhinocommands,
    AnalogTrigger=export)  # -> out, Messages, ExportDirectory, ExportFilename, ExportExtension, ExportFile; inputs Geometries: tree of GeometryBase, LayerNames: tree of String, LayerColors: tree of Color, Directory: String, FilePrepend: String, Filename: String, FileAppend: String, Extension: String, ExportOptions: String, RhinoCommands: String, AnalogTrigger: Double
# ---------- c_script: C# usings ----------
using System.IO;
using Rhino.DocObjects;
using System.Drawing;
using System.Linq;
# ---------- c_script: C# ----------
    bool diagnosticOutput = false;
    bool showAnalog = false;
    if (AnalogTrigger != previousAnalogTrigger)
    {
      Messages = MessageString;
      if (showAnalog)
      {
        RhinoApp.WriteLine(AnalogTrigger.ToString());
      }

      if (AnalogTrigger == -1) //If AnalogTrigger becomes -1 the input was disconnected
      {
        if (messageType != 0)
        {
          MessageString = "";
          AddMessage("Connect a Boolean Button, or a Contol Knob to the AnalogTrigger input");
          Messages = MessageString;
          messageType = 0;
        }
        InputType = InputDisconnected;
        AnalogWasSmall = false;
        triggerConnected = false;
      }
      else
        if (AnalogTrigger == 0) //The input is connected to a Digital input and is ready
      {
        if (messageType != 1)
        {
          MessageString = "";
          AddMessage("Connected as a Digital Input - Ready to Export");
          AddMessage("Keep Input active until Export is completed");
          Messages = MessageString;
          messageType = 1;
          InputType = InputDigital;
          AnalogWasSmall = true;
          triggerConnected = true;
        }
      }
      else
        if (AnalogTrigger == 1) //The input is connected to a Digital input that is already active
      {
        if (messageType != 2 && messageType != 1)
        {
          MessageString = "";
          AddMessage("Connected as a Digital Input - Already Active");
          AddMessage("Set Input to False to Reset");
          Messages = MessageString;
          messageType = 2;
          InputType = InputDigital;
          AnalogWasSmall = false;
          triggerConnected = true;
        }
      }
      else
        if (AnalogTrigger < 2.55 || AnalogTrigger > 3.45) //check range of valid analog input
      {
        if (messageType != 3)
        {
          MessageString = "";
          AddMessage("Connected as an Analog Input - Out of Range");
          AddMessage("The range for analog input is 2.55 to 3.45");
          Messages = MessageString;
          messageType = 3;
          InputType = InputAnalog;
          AnalogWasSmall = false;
          triggerConnected = false;
        }
      }
      else //must be an valid analog input
      {
        if (AnalogTrigger >= 2.6) //already active when connected
        {
          if (messageType != 4)
          {
            MessageString = "";
            AddMessage("Connected as an Analog Input - Already Active");
            AddMessage("Set Input to Minimum to Reset");
            Messages = MessageString;
            messageType = 4;
            InputType = InputAnalog;
            AnalogWasSmall = false;
            triggerConnected = true;
          }
        }
        else //ready when connected
        {
          if (messageType != 4)
          {
            MessageString = "";
            AddMessage("Connected as an Analog Input - Ready to Export");
            AddMessage("Increase value to Export - keep at Maximum until export is completed");
            Messages = MessageString;
            messageType = 4;
            InputType = InputAnalog;
            AnalogWasSmall = false;
            triggerConnected = true;
          }
        }
      }
    }

    if (triggerConnected)
    {
      if ((AnalogTrigger >= 2.5 && AnalogTrigger < 2.6) || AnalogTrigger == 0)
      {
        signal = false;
        directory = null;
        filename = null;
        extension = null;
        prepended = false;
        appended = false;
        overwritecheck = false;
        assembled = false;
        ExportDirectory = null;
        ExportFilename = null;
        ExportExtension = null;
        ExportFile = null;
        //      MessageString = "";
        NewFilename = null;
        AnalogWasSmall = true;
        if (!analogReset)
        {
          messageType = -1;
        }
        analogReset = true;
      }
      if (AnalogWasSmall)
      {
        if ((AnalogTrigger > 2.7 || AnalogTrigger == 1) && directory == null)
        {
          analogReset = false;
          if (Directory == null)
          {
            string rhinodocpath = Rhino.RhinoDoc.ActiveDoc.Path;
            if (Path.GetFileNameWithoutExtension(rhinodocpath) == null)
            {
              AddMessage("Directory not specified, and no Rhino Document is loaded. Setting a default directory");
              directory = Path.Combine(Environment.GetFolderPath(Environment.SpecialFolder.MyDocuments), "GrasshopperExportedFiles");
            }
            else
            {
              AddMessage("Directory not specified, using Rhino Document Directory");
              string fullPath = Rhino.RhinoDoc.ActiveDoc.Path;
              directory = Path.GetDirectoryName(fullPath);
            }
          }
          else
          {
            AddMessage("Using Directory specified");
            directory = Directory;
          }
          if (!directory.EndsWith("\\"))
          {
            directory += "\\";
          }
          AddMessage("Export Directory: " + directory);
          Messages = MessageString;
          if (!System.IO.Directory.Exists(directory))
          {
            AddMessage("Directory does not exits. Creating Directory: " + directory);
            System.IO.Directory.CreateDirectory(directory);
          }
          Messages = MessageString;
        }
        if ((AnalogTrigger > 2.8 || AnalogTrigger == 1) && (filename == null))
        {
          if (Filename == null)
          {
            string fullPath = Rhino.RhinoDoc.ActiveDoc.Path;
            filename = Path.GetFileNameWithoutExtension(fullPath);
            if (filename == null)
            {
              AddMessage("Filename not specified, and no Rhino Document is loaded. Setting a default filename");
              filename = "Export Example";
            }
            else
            {
              AddMessage("Filename not specified, using Rhino Document Name");
            }
          }
          else
          {
            AddMessage("Using Filename specified");
            filename = Filename;
          }
          AddMessage("Export Filename:" + filename);
          ExportFilename = filename;
          Messages = MessageString;
        }

        if ((AnalogTrigger > 2.9 || AnalogTrigger == 1) && (extension == null))
        {
          if (Extension == null)
          {
            AddMessage("No FileExtension specified, using .3dm");
            extension = ".3dm";
          }
          else
          {
            AddMessage("Using Extension specified");
            extension = Extension;
          }
          if (!extension.StartsWith("."))
          {
            extension = "." + extension;
          }
          AddMessage("Export Extension: " + extension);
          Messages = MessageString;
        }
        if ((AnalogTrigger > 3.0 || AnalogTrigger == 1) && (prepended == false))
        {
          if (FilePrepend == null)
          {
            AddMessage("No FilePrepend specified, Skipping Prepend");
          }
          else
          {
            AddMessage("PrePending: " + FilePrepend + " to beginning of filename");
            filename = FilePrepend + filename;
            AddMessage("Export Filename:" + filename);
          }
          prepended = true;
          Messages = MessageString;
        }
        if ((AnalogTrigger > 3.1 || AnalogTrigger == 1) && (appended == false))
        {
          if (FileAppend == null)
          {
            AddMessage("No FileAppend  specified, Skipping Append");
          }
          else
          {
            AddMessage("Appending: " + FileAppend + " to end of filename");
            filename = filename + FileAppend;
            AddMessage("Export Filename:" + filename);
          }
          appended = true;
          Messages = MessageString;
        }
        if ((AnalogTrigger > 3.2 || AnalogTrigger == 1) && (overwritecheck == false))
        {
          AddMessage("Checking if " + directory + filename + extension + " = " + Rhino.RhinoDoc.ActiveDoc.Path);
          if (string.Equals(Rhino.RhinoDoc.ActiveDoc.Path, directory + filename + extension, StringComparison.OrdinalIgnoreCase))
          {
            AddMessage("To prevent overwriting the Rhino file, ' - Exported' has been appended to the filename.");
            filename = filename + " - Exported";
            AddMessage("Export Filename:" + filename);
          }
          else
          {
            AddMessage("No Conflict with the Rhino file");
          }
          overwritecheck = true;
          Messages = MessageString;
        }
        if ((AnalogTrigger > 3.3 || AnalogTrigger == 1) && (assembled == false))
        {
          NewFilename = directory + filename + extension;
          AddMessage("Export File:" + NewFilename);
          assembled = true;
          Messages = MessageString;
        }
        if ((AnalogTrigger > 3.4 || AnalogTrigger == 1) && (AnalogWasSmall))
        {
          signal = true;
          if (InputType == InputDigital)
          {
            AddMessage("Hold Button Until Export is Finished");
          }
          else
          {
            AddMessage("Keep AnalogInput at Maximum until Export is Finished");
          }
          Messages = MessageString;
        }
      }
    }
    counter = signal ? counter + 1 : 0;
    // MessageString = !signal ? "" : MessageString;
    ExportDirectory = directory;
    ExportFilename = filename;
    ExportExtension = extension;
    ExportFile = NewFilename;
    if (counter == 1)
    {
      DateTime startTime = DateTime.Now;
      AddMessage("Starting the export process at " + startTime.ToString("h:mm:ss tt"));
      Messages = MessageString;
      Rhino.UnitSystem originalUnitSystem = Rhino.RhinoDoc.ActiveDoc.ModelUnitSystem;
      try
      {
        if (!System.IO.Directory.Exists(directory))
        {
          AddMessage("Error: The specified directory: \"" + directory + "\" does not exist.");
          Messages = MessageString;
        }
        else if (string.IsNullOrWhiteSpace(NewFilename) ||
          !(NewFilename.EndsWith(".3dm", StringComparison.OrdinalIgnoreCase) ||
          NewFilename.EndsWith(".dxf", StringComparison.OrdinalIgnoreCase) ||
          NewFilename.EndsWith(".dgn", StringComparison.OrdinalIgnoreCase) ||
          NewFilename.EndsWith(".obj", StringComparison.OrdinalIgnoreCase) ||
          NewFilename.EndsWith(".stl", StringComparison.OrdinalIgnoreCase) ||
          NewFilename.EndsWith(".step", StringComparison.OrdinalIgnoreCase) ||
          NewFilename.EndsWith(".iges", StringComparison.OrdinalIgnoreCase)))
        {
          AddMessage("Error: The specified filename: \"" + NewFilename + "\" is invalid or does not have a supported extension.");
          Messages = MessageString;
        }
        else if (Geometries == null || Geometries.BranchCount == 0)
        {
          AddMessage("Error: No geometry data provided.");
          Messages = MessageString;
        }
        else if (Geometries.BranchCount != LayerNames.BranchCount || Geometries.BranchCount != LayerColors.BranchCount)
        {
          AddMessage("Error: The number of branches in Geometries (" + Geometries.BranchCount +
            "), LayerNames (" + LayerNames.BranchCount + "), and LayerColors (" +
            LayerColors.BranchCount + ") must be the same.");
          Messages = MessageString;
        }
        else
        {
          // Create lists to hold the guids for each layer and for temporary objects
          var guidsByLayer = new List<List<Guid>>();
          var tempObjectGuids = new List<Guid>();

          // Create and add layers based on the data tree of layer names and colors
          var layerIndices = new List<int>();
          for (int i = 0; i < LayerNames.BranchCount; i++)
          {
            var layerName = LayerNames.Branches[i][0];
            var layerColor = LayerColors.Branches[i][0];

            var layerIndex = Rhino.RhinoDoc.ActiveDoc.Layers.Add(layerName, layerColor);
            layerIndices.Add(layerIndex);

            guidsByLayer.Add(new List<Guid>());
          }

          // Loop through the data tree of geometries and add objects to layers
          for (int i = 0; i < Geometries.BranchCount; i++)
          {
            var branch = Geometries.Branches[i];
            var layerIndex = layerIndices[i];
            var layerName = LayerNames.Branches[i][0];

            foreach (var geometry in branch)
            {
              if (geometry != null)
              {
                var guid = Rhino.RhinoDoc.ActiveDoc.Objects.Add(geometry);
                guidsByLayer[i].Add(guid);
                tempObjectGuids.Add(guid);

                // Modify the attributes of the added object to specify the desired layer index
                var objAttributes = Rhino.RhinoDoc.ActiveDoc.Objects.FindId(guid).Attributes;
                objAttributes.LayerIndex = layerIndex;
                Rhino.RhinoDoc.ActiveDoc.Objects.ModifyAttributes(guid, objAttributes, false);
                if (diagnosticOutput) { AddMessage("Assigning geometry to Layer: " + layerName); Messages = MessageString; }
              }
              else
              {
                if (diagnosticOutput) { AddMessage("Skipping null geometry for layer: " + layerName); Messages = MessageString; }
              }
            }
          }

          // Select all objects created in the script
          List<Guid> allGuids = new List<Guid>();
          foreach (var guids in guidsByLayer)
          {
            allGuids.AddRange(guids);
          }
          Rhino.RhinoDoc.ActiveDoc.Objects.Select(allGuids);

          // Dictionary to store GUIDs for each step
          Dictionary<string, List<Guid>> stepGuids = new Dictionary<string, List<Guid>>();

          string defaultRhinoCommands = "";
          string rhinoCommandsInput = RhinoCommands as string;
          string[] commandList = (string.IsNullOrEmpty(rhinoCommandsInput) ? defaultRhinoCommands : rhinoCommandsInput).Split(new[] { '\n', ';' }, StringSplitOptions.RemoveEmptyEntries);
          // Check if there are any additional commands
          if (commandList.Length > 0)
          {
            AddMessage("Running additional Rhino Commands...");
            foreach (string command in commandList)
            {
              AddMessage(command);
              Messages = MessageString;

              bool requiresCurves =
                command.ToLower().Contains("convert") ||
                command.ToLower().Contains("chamfercrv") ||
                command.ToLower().Contains("extendcrv") ||
                command.ToLower().Contains("trim") ||
                command.ToLower().Contains("split") ||
                command.ToLower().Contains("join") ||
                command.ToLower().Contains("curveboolean") ||
                command.ToLower().Contains("curvethroughpt") ||
                command.ToLower().Contains("offsetcrv") ||
                command.ToLower().Contains("curveeditptson") ||
                command.ToLower().Contains("match") ||
                command.ToLower().Contains("rebuild") ||
                command.ToLower().Contains("simplifycrv") ||
                command.ToLower().Contains("offset") ||
                command.ToLower().Contains("deviation");


              // Check if there are any curves before executing the steps
              var selectedObjects = Rhino.RhinoDoc.ActiveDoc.Objects.GetSelectedObjects(false, false);

              var hasCurves = selectedObjects != null && selectedObjects.Any(obj => obj.ObjectType == Rhino.DocObjects.ObjectType.Curve);

              if (requiresCurves && !hasCurves)
              {
                AddMessage("Skipping command: " + command + " (requires curves, but no curves are available)");
                Messages = MessageString;
                continue;
              }
              if (command.StartsWith("proauto", StringComparison.OrdinalIgnoreCase)) //run Special ProAuto commands that are diffiuclt any other way
              {
                var ProAutoCommand = command.Substring(command.IndexOf("(") + 1, command.IndexOf(")") - command.IndexOf("(") - 1).Trim();
                AddMessage("Running Proauto command: " + ProAutoCommand);
                Messages = MessageString;
                if (ProAutoCommand.Equals("Millimeterfix", StringComparison.OrdinalIgnoreCase))
                {
                  Rhino.RhinoDoc.ActiveDoc.ModelUnitSystem = Rhino.UnitSystem.Millimeters;
                }
              }
              else
              {
                Rhino.RhinoApp.RunScript(command, true);
              }

              // Get the selected objects and store their GUIDs in the dictionary
              selectedObjects = Rhino.RhinoDoc.ActiveDoc.Objects.GetSelectedObjects(true, false);
              stepGuids[command] = selectedObjects.Select(obj => obj.Id).ToList();
            }
          }

          //

          // Define the file path
          string filepath = Path.Combine(directory, NewFilename);

          // Display export start message
          AddMessage("Exporting to " + filepath);
          Messages = MessageString;


          // Loop through the layers and count the exported entities
          for (int i = 0; i < LayerNames.BranchCount; i++)
          {
            var layerName = LayerNames.Branches[i][0];
            var entityCount = guidsByLayer[i].Count;
            AddMessage("Exporting " + entityCount + " entities to Layer: " + layerName);
            Messages = MessageString;
          }

          // Run export script
          string exportOptions = ExportOptions ?? "";
          if (File.Exists(filepath))
          {
            try
            {
              File.Delete(filepath);
            }
            catch (Exception ex)
            {
              AddMessage("Error deleting existing file: " + ex.Message);
            }
          }
          Rhino.RhinoApp.RunScript("_-Export " + exportOptions + " \"" + filepath + "\"" + " _Enter", true);

          foreach (var kvp in stepGuids)
          {
            Rhino.RhinoDoc.ActiveDoc.Objects.Delete(kvp.Value, false);
          }

          // Delete all the objects added to layers during the script
          Rhino.RhinoDoc.ActiveDoc.Objects.Delete(allGuids, false);
          Rhino.RhinoDoc.ActiveDoc.Objects.Delete(tempObjectGuids, false);

          // Delete the temporary layers
          foreach (var layerIndex in layerIndices)
          {
            Rhino.RhinoDoc.ActiveDoc.Layers.Delete(layerIndex, false);
          }
          DateTime finishTime = DateTime.Now;
          TimeSpan runtime = finishTime - startTime;

          AddMessage("Export completed at " + finishTime.ToString("h:mm:ss tt") +
            ". Total runtime: " + runtime.TotalSeconds + " seconds.");
          if (InputType == InputDigital)
          {
            AddMessage("Release Button");
          }
          else
          {
            AddMessage("Return Analog Input to Minimum to Reset");
          }
          Messages = MessageString;
          AnalogWasSmall = false;
          Rhino.RhinoDoc.ActiveDoc.ModelUnitSystem = originalUnitSystem;
        }
      }
      catch (Exception ex)
      {
        AddMessage("An error occurred: " + ex.Message);
      }
    }
# ---------- c_script: C# additional code ----------
  private void AddMessage(string message)
  {
    ConsoleMessage = message;
    RhinoApp.WriteLine(ConsoleMessage);
    MessageString += "\n" + ConsoleMessage;
  }
  int counter;
  string MessageString;
  string ConsoleMessage;
  bool signal;
  string filename;
  string directory;
  string extension;
  string NewFilename;
  double previousAnalogTrigger = double.NaN;
  bool prepended;
  bool appended;
  bool overwritecheck;
  bool assembled;
  bool AnalogWasSmall = false;
  bool triggerConnected = false;
  const int InputDigital = 1;
  const int InputAnalog = -1;
  const int InputDisconnected = 0;
  int InputType = InputDisconnected;
  int messageType = -1;
  bool analogReset = false;
# ---------- end c_script ----------
compiler_output = Panel(c_script.out)
messages = Panel(c_script.Messages)
filename_for_exported_file = Panel(c_script.ExportFilename)
directory_for_exported_file = Panel(c_script.ExportDirectory)
extension_for_exported_file = Panel(c_script.ExportExtension)
full_file_path_for_exported_file = Panel(c_script.ExportFile)
